# Grasshopper definition Geometry Gym Grasshopper to GSA.gh (Grasshopper 0.9.76)

# Elastic Orthotropic
panel = Panel("2.05E9")
# Fabric
panel_2 = Panel("MyFabric")
# Requires ggRhinoGSA and BullAnt from http://www.geometrygym.com/downloads
# Assumes rhino documents have millimetre units
# Notes
# + You can use any units you like, but you need to scale the dimensions appropriately.
# + Recommended to change Grasshopper Display setting to "Draw Full Names" on Display Menu
# + All components output text in GWA data  format
# New Features to Implement (coming soon)
panel_3 = Panel("GhGsaTitle")
vector_xyz = VectorXYZ(XComponent=panel, YComponent=panel, ZComponent=panel)  # -> Vector, Length
# GSA Library
# Elastic Isotropic
panel_4 = Panel("MySteel")
# Create GSA Load Case
panel_5 = Panel("MyLoadCase")
gggsalocation = GgGSALocation(North=90, Elevation=0, Latitude=0, Longitude=0)
# Create GSA Project Data
gggsaproject = GgGSAProject(Title=panel_3, Subtitle="GhGsaSubTitle", CalcHeader="GhGsaCalcHeader", JobNumber="1", Initials="gh")
# Create GSA Material
gggsacreate_material = GgGSACreateMaterial(StandardStructureMaterial="CONC_SHORT")
gggsacreate_elastic_orthotropic_material = GgGSACreateElasticOrthotropicMaterial(
    Name="MyOrthoSteel",
    StandardStructureMaterial="UNDEF",
    ElasticModulusPa=vector_xyz.Vector,
    PoissonsRatio=Vector(0.3, 0.3, 0.3),
    Density=7850,
    CoefficientOfThermalExpansion=Vector(1.2e-05, 1.2e-05, 1.2e-05),
    ShearModulusPa=Vector(0, 0, 0),
    DampingRatio=0,
    Color=RGBA(0, 0, 0, 0))
gggsacreate_elastic_isotropic_material = GgGSACreateElasticIsotropicMaterial(
    Name=panel_4,
    ElasticModulusPa=2.05e+11,
    PoissonsRatio=0.3,
    ShearModulusPa=0,
    Density=7850,
    CoefficientOfThermalExpansion=1.2e-05,
    DampingRatio=0)
gggsacreate_fabric_material = GgGSACreateFabricMaterial(
    Name=panel_2,
    ID=1,
    FabricWarpModulusNM=800000,
    FabricWeftModulusNM=400000,
    PoissonsRatio=0.45,
    ShearModulusNM=30000,
    Compression=False)
gggsaloadcase = GgGSALoadCase(Name=panel_5, ID=1, LoadCaseType="UNDEF", Bridge=False)
panel_6 = Panel(gggsaproject)
# Right Click input for combo box selection
panel_7 = Panel(gggsacreate_material)
panel_8 = Panel(gggsacreate_fabric_material)
panel_9 = Panel(gggsacreate_elastic_isotropic_material)
# Create GSA Region
panel_10 = Panel(gggsacreate_elastic_orthotropic_material)
panel_11 = Panel(gggsaloadcase)
# Export Model From Grasshopper
# Double Click on ggGSABakeModel to export
# out to the GSA Application.   You should have
# GSA running with the opening dialog cleared
# prior to baking, else GSA will be started as a
# background service you can't access.
# (this is useful if you are executing the solver
# and don't need manual interaction)
# Restart Rhino and GSA if problems.
# Don't manually close GSA documents
# Right click options :
# add GWA data to clipboard when baking
# new model initiated each bake
# Supress license to enable Architects to visualize model with BullAnt license
# Create GSA Beam
# Create GSA FiniteElements
gggsabakemodel = GgGSABakeModel(ClipSummary=False, NewFile=False)
# Stream Bake to File
panel_12 = Panel("C:\MyWork\GSA\bake.gwb")
# Solve GSA Model
# Extract Results
gggsastream_bake = GgGSAStreamBake(Path=panel_12, Enabled=Toggle(False))
