# Grasshopper definition Geometry Gym Grasshopper to SAP.gh (Grasshopper 0.9.76)

vector_xyz = VectorXYZ(XComponent="2.05E9", YComponent="2.05E9", ZComponent="2.05E9")  # -> Vector, Length
# SAP Library
panel = Panel("S355")
# Elastic Isotropic
panel_2 = Panel("MySteel")
# Elastic Orthotropic
ggsapcreate_elastic_orthotropic_material = GgSAPCreateElasticOrthotropicMaterial(
    Name="MyOrthoSteel",
    ElasticModulusPa=vector_xyz.Vector,
    PoissonsRatio=Vector(0.3, 0.3, 0.3),
    Density=7850,
    CoefficientOfThermalExpansion=Vector(1.2e-05, 1.2e-05, 1.2e-05),
    ShearModulusPa=Vector(0, 0, 0),
    Color=RGBA(0, 0, 0, 0))
ggsapcreate_elastic_isotropic_material = GgSAPCreateElasticIsotropicMaterial(
    Name=panel_2,
    ElasticModulusPa=2.05e+11,
    PoissonsRatio=0.3,
    ShearModulusPa=0,
    Density=7850,
    CoefficientOfThermalExpansion=1.2e-05,
    DampingRatio=0)
# Requires ggRhinoSAP and BullAnt from http://www.geometrygym.com/downloads
# Assumes rhino documents have millimetre units
# Notes
# + You can use any units you like, but you need to scale the dimensions appropriately.
# + Recommended to change Grasshopper Display setting to "Draw Full Names" on Display Menu
# New Features to Implement (coming soon)
# Create SAP Material
ggsaplibrarymaterial = GgSAPLibraryMaterial(Name=panel)
# Create SAP Load Pattern
ggsaploadpattern = GgSAPLoadPattern(Name="MyLoadPattern", LoadPatternType="DEAD", SelfWeightMultiplier=0)
ggsapcreate_steel = GgSAPCreateSteel(StandardStructureSteel="ASTM_A36")
panel_3 = Panel(ggsapcreate_elastic_orthotropic_material)
panel_4 = Panel(ggsaplibrarymaterial)
panel_5 = Panel(ggsapcreate_elastic_isotropic_material)
# Create SAP Areas
panel_6 = Panel(ggsaploadpattern)
# Solve SAP Model
# Export Model From Grasshopper
# Extract Results
# Double Click on ggSAPBakeModel to export
# out to the SAP2000 Application.   First
# time you bake in each Rhino session,
# the SAP2000 application should start.
# Right click options :
# new model initiated each bake
# Supress license to enable Architects to visualize model with BullAnt license
# Create SAP Beam
# Create SAP FiniteElements
ggsapbakemodel = GgSAPBakeModel(ClipSummary=False, NewFile=False, TagReplace=True, Units="kN_m_C")
