# Grasshopper definition 141111 Truss.gh (Grasshopper 0.9.76)
# plug-ins: Karamba, ggGHKarambaGHA

Y = UnitY(Factor="100")
line = Line([Line((0, 0, 0), (4, 0, 0)), Line((4, 0, 0), (0, 4, 0))])
pt = Point([Point(0, 0, 0), Point(0, 4, 0)])
pt_2 = Point(Point(4, 0, 0))
pload = PointLoad(Vector=Y, PosInd=pt_2, LCase=0)
linetobeam = LineToBeamKaramba(Line=line, New=True, Remove=True, LDist=0.005)  # -> Points, Element, Info
supp = Support(PosInd=pt, menu=[buttons(on, on, on, off, off, off)])
supp_2 = Support(PosInd=pt_2, menu=[buttons(off, off, on, off, off, off)])
modify_beam = ModifyBeam(
    Beam=linetobeam.Element,
    Bending=Toggle(False),
    Active=True,
    Height_cm=-1,
    Thickness_cm=-1,
    ConsiderBuckling=True,
    BucklingLengthY_m=-1,
    BucklingLengthZ_m=-1,
    NII_kN=0)
orientate = OrientateBeamKaramba(Beam=modify_beam, Alpha_deg=Slider(20, range=0..100))
assemble = AssembleModelKaramba(Beam=orientate, Support=[supp, supp_2], Load=pload, LDist=0.005)  # -> Model, Info, Mass
analyze = Analyze(Model=assemble.Model)  # -> ModelWithDisplacements, MaximumDisplacement, ResultingForceOfGravity, ElasticEnergy
modelview = ModelViewKaramba(Model=analyze.ModelWithDisplacements, LoadCaseFactorsForLinearSuperposition=1, IndexIncrementOfVisibleLoadcase=0)  # -> Model, MeshOfRendering, DeformedStructure, DeformedModel
beamview = BeamViewKaramba(Model=modelview.Model)  # -> Model, MeshOfRendering, DeformedBeamAxes, LegendColors, LegendTags
disp = NodalDisplacements(Model=analyze.ModelWithDisplacements)  # -> ModelWithDisplacements, NodalTranslations, NodalRotations
panel = Panel(disp.NodalTranslations)
panel_2 = Panel(disp.NodalRotations)
panel_3 = Panel("C:\My Work\Geometry Gym\documents\GeometryGym\analysis\karamba\truss.stp")
# C:\My Work\Geometry Gym\documents\GeometryGym\analysis\karamba\truss.ifc
s_force = SectionForces(
    Model=disp.ModelWithDisplacements,
    NumberOfProbingPointsPerElement=3,
    MaximumProbingDistance_m_2=-1,
    NumberOfProbingPointsPerElement_2=3)  # -> ModelWithDisplacements, NormalForce, ResultantBendingMoment, ResultantShearForce
panel_4 = Panel(s_force.NormalForce)
panel_5 = Panel(s_force.ResultantBendingMoment)
panel_6 = Panel(s_force.ResultantShearForce)
ggkarambaexport = GgKarambaExport(Enabled=True, Model=s_force.ModelWithDisplacements, IFC4=False, FilePath=panel_3)
export_model_to_dstv_karamba = ExportModelToDStVKaramba(Model=s_force.ModelWithDisplacements, Path=panel_3, menu=[buttons(on, off, off, off)])  # -> DStV, Info
d_energy = DeformationEnergy(Model=s_force.ModelWithDisplacements)  # -> ModelWithDisplacements, AxialDeformationEnergies, BendingEnergies
panel_7 = Panel(export_model_to_dstv_karamba.DStV)
panel_8 = Panel(d_energy.AxialDeformationEnergies)
panel_9 = Panel(d_energy.BendingEnergies)
