# Grasshopper definition 141112 ShellAndBeam.gh (Grasshopper 0.9.76)
# plug-ins: karamba, ggGHKaramba

subdiv = Slider(5, range=1..50)
gene_list = GeneList(Decimals=3, Maximum=1, Minimum=0, Value=[0.918399156, 0.03822685594, 0.5014556295, 0.831951132, 0.3889623994])
gene_list_2 = GeneList(Decimals=3, Maximum=1, Minimum=0, Value=[0.09707403094, 0.8672474417, 0.5913484793, 0.4196536934, 0.7027743662])
gene_list_3 = GeneList(Decimals=3, Maximum=1, Minimum=0, Value=[0.691, 0.493, 0.29, 0.217, 0.698])
gene_list_4 = GeneList(Decimals=3, Maximum=1, Minimum=0, Value=[0.417, 0.605, 0.5, 0.432, 0.483])
dimension_x_and_y = Panel("0 to 10")
wave = Slider(0.516, range=0..1)
range = Range(Domain=dimension_x_and_y, Steps=subdiv)
panel = Panel("""x*pi
x*pi+pi""")
vec = VectorXYZ(XComponent=gene_list, YComponent=gene_list_2, ZComponent=0)  # -> Vector, Length
item = ListItem(List=reverse(range), Index=0, Wrap=False)
eval = Evaluate(F="sin(z*(sqrt((-5-x)²+(-5-y)²)))", x=range, y=graft(range), z=wave)
eval_2 = Evaluate(F=panel, x=graft(gene_list_3))
eval_3 = Evaluate(F="pi/4 + x*pi/5", x=gene_list_4)
eval_4 = Evaluate(F="0.15*{1,1,0}*x + y*0.7*x - {0,0,x/4}", x=item, y=vec.Vector)
hull = ConvexHull(Points=eval_4, Plane=PlaneXY(0, 0, 0))  # -> Hull, HullZ, Indices
len = Length(Curve=hull.HullZ)
ma = MassAddition(Input=flatten(len))  # -> Result, PartialResults
vec_2 = VectorXYZ(XComponent=range, YComponent=graft(range), ZComponent=eval)  # -> Vector, Length
pt = PointPolar(BasePlane=graft(eval_4), XYAngle=eval_2, ZAngle=graft(eval_3), Offset=item)
ln = Line(StartPoint=graft(eval_4), EndPoint=pt)  # -> graft(Line)
galapagos = Galapagos(fitness=num_2, gene=[gene_list, gene_list_2, gene_list_3, gene_list_4, wave])
pull = PullPoint(Point=flatten(vec_2.Vector), Geometry=ln, Closest=True)  # -> ClosestPoint, Distance
srfgrid = SurfaceFromPoints(Points=flatten(vec_2.Vector), UCount=expr("x+1", subdiv), Interpolate=False)
del = DelaunayMesh(Points=flatten(vec_2.Vector), Plane=PlaneXY(0, 0, 0))
sort = SortList(Keys=pull.Distance, ValuesA=flatten(vec_2.Vector))  # -> Keys, ValuesA
item_2 = ListItem(List=sort.ValuesA, Index=0, Wrap=False)  # -> simplify(Element)
path_mapper = PathMapper(item_2, source="{A;B}", target="{A}")
ln_2 = Line(StartPoint=graft(eval_4), EndPoint=path_mapper)  # -> flatten(Line)
rdpoints = RemoveDuplicatePointsKaramba(Point=flatten([vec_2.Vector, eval_4, path_mapper]), LDist=0.005)  # -> OutPoint, Info, Indexes
rdlines = RemoveDuplicateLinesKaramba(Line=ln_2, LDist=0.005)  # -> OutLine, Info, Indexes
id = Panel("shell")
id_2 = Panel("beams")
shellcrosec = ShellCrossSectionKaramba(ElementIdentifiers=id, Heights_cm="10")
supp = SupportKaramba(PosInd=eval_4, menu=[buttons(on, on, on, off, off, off)])
linetobeam = LineToBeamKaramba(Point=rdpoints.OutPoint, Line=rdlines.OutLine, New=True, Remove=True, LDist=0.005, Identifier=id_2)  # -> Point, Beam, Info
profile = BoxProfileKaramba(
    BeamId=id_2,
    Height_cm="10",
    UpperFlangeWidth_cm="7",
    LowerFlangeWidth_cm="7",
    UpperFlangeThickness_cm="0.5",
    LowerFlangeThickness_cm="0.5",
    SidewallsThickness_cm="0.5")
gravity = GravityKaramba(Vector=Vector(0, 0, -1), LCase=0)
meshtoshell = MeshToShellKaramba(Point=rdpoints.OutPoint, Mesh=del, LDist=0.005, Identifier=id)  # -> Point, Shell, Info
panel_2 = Panel("C:\My Work\Geometry Gym\documents\GeometryGym\analysis\karamba\shellandbeam.ifc")
assemble = AssembleModelKaramba(
    Point=rdpoints.OutPoint,
    Elem=[meshtoshell.Shell, linetobeam.Beam],
    Support=supp,
    Load=gravity,
    CrossSection=shellcrosec,
    LDist=0.005)  # -> Model, Info, Mass
ggkarambaexport = GgKarambaExport(Enabled=True, Model=assemble.Model, FilePath=panel_2)
analyze = AnalyzeKaramba(Model=assemble.Model)  # -> ModelWithDisplacements, MaximumDisplacement, ResultingForceOfGravity, ElasticEnergy
num = Number(analyze.MaximumDisplacement)
sqr = Square(Value=num)
multiplication = Multiplication(A=sqr, B=10000000)
subtraction = Subtraction(A=multiplication, B=ma.Result)
num_2 = Number(subtraction)
panel_3 = Panel(num_2)
panel_4 = Panel(ggkarambaexport)
eval_5 = Evaluate(F="\"displacement: \" & round((x*1000),1) & \" mm\"", x=analyze.MaximumDisplacement)
panel_5 = Panel(eval_5)
modelview = ModelViewKaramba(Model=analyze.ModelWithDisplacements, LoadCaseFactorsForLinearSuperposition=1, IndexIncrementOfVisibleLoadcase=0)  # -> Model, MeshOfRendering, DeformedStructure, DeformedModel
multiplier = Slider(1, range=1..10)
addition = Addition(A=subdiv, B=1)
srf = Surface(srfgrid)
multiplication_2 = Multiplication(A=addition, B=multiplier)
beamview = BeamViewKaramba(Model=modelview.Model)  # -> Model, MeshOfRendering, DeformedBeamAxes, LegendColors, LegendTags
shellview = ShellViewKaramba(Model=modelview.Model)  # -> Model, MeshOfRendering, LegendColors, LegendTags
sdivide = DivideSurface(Surface=srf, UCount=multiplication_2, VCount=multiplication_2)  # -> Points, Normals, Parameters
line = LineSDL(Start=sdivide.Points, Direction=sdivide.Normals, Length=1)
slider = Slider(0.3, range=0..1)
pt_2 = PointXYZ(XComponent=Slider(-1, range=-1..1), YComponent=Slider(1, range=-1..1), ZComponent=0, System=PlaneXY(0, 0, 0))
shellforceflow = ForceFlowLinesOnShellsKaramba(Model=shellview.Model, Layer=0, GlobalForceDirection=pt_2, IntersectingLine=line, SegmentLength=0.5, DA=5, Theta=0)  # -> Model, Line
isolines = IsoLinesOnShellsKaramba(
    Model=shellview.Model,
    Layer=0,
    IntersectingLine=line,
    SegmentLength=slider,
    Smoothing=False,
    menu=[buttons(off, off, off, on)])  # -> Model, Lines, Value
pstressline = PrincipalStressLinesOnShellsKaramba(Model=shellview.Model, Layer=0, IntersectingLine=line, SegmentLength=slider, DA=slider)  # -> Model, Lines1, Lines2
