# Grasshopper definition 141112 SuspensionBridge.gh (Grasshopper 0.9.76)
# plug-ins: karamba, ggGHKaramba

height = Slider(35, range=1..100)
panel = Panel("""(x+120)²/3600*y
x²/3600*y
(x-120)²/3600*y""")
panel_2 = Panel("""-120 to -60
-54 to 54
60 to 120""")
panel_3 = Panel("""10
18
10""")
# create axis geometry
range = Range(Domain=panel_2, Steps=panel_3)
f_x_y = F2(Function=graft(panel), X=range, Y=height)
equals = Equality(FirstNumber=flatten(f_x_y), SecondNumber=height)  # -> Equality, Inequality
vec = VectorXYZ(XComponent=flatten(range), YComponent=0, ZComponent=flatten(f_x_y))  # -> Vector, Length
vec_2 = VectorXYZ(XComponent=flatten(range), YComponent=0, ZComponent=0)  # -> Vector, Length
pline = PolyLine(Vertices=vec.Vector, Closed=False)
cull = CullPattern(List=vec.Vector, CullPattern=equals.Equality)
pline_2 = PolyLine(Vertices=vec_2.Vector, Closed=False)
vcomp = Decompose(Vector=cull)  # -> XComponent, YComponent, ZComponent
vec_3 = VectorXYZ(XComponent=vcomp.XComponent, YComponent=vcomp.YComponent, ZComponent=-20)  # -> Vector, Length
explode = Explode(Curve=pline, Recursive=True)  # -> flatten(Segments), Vertices
explode_2 = Explode(Curve=pline_2, Recursive=True)  # -> flatten(Segments), flatten(Vertices)
ln = Line(PointA=cull, PointB=vec_3.Vector)  # -> flatten(Line)
end = EndPoints(Curve=pline_2)  # -> Start, End
ln_2 = Line(PointA=vec.Vector, PointB=vec_2.Vector)
path_mapper = PathMapper(explode_2.Segments, source="{A}", target="{3}")
path_mapper_2 = PathMapper(explode.Segments, source="{A}", target="{0}")
path_mapper_3 = PathMapper(ln_2, source="{A}", target="{1}")
path_mapper_4 = PathMapper(ln, source="{A}", target="{2}")
rdpoints = RemoveDuplicatePoints(Point=flatten([explode.Vertices, explode_2.Vertices, vec_3.Vector]), LDist=0.005)  # -> OutPoint, Info, Indexes
slider = Slider(25, range=0..40)
# all points
pt = Point(flatten(rdpoints.OutPoint))
# position point load
item = ListItem(List=vec_2.Vector, Index=Slider(18, range=0..40), Wrap=False)
# convert axis
# to beams
linetobeam = LineToBeamKaramba(Point=pt, Line=[path_mapper_2, path_mapper_3, path_mapper_4, path_mapper], New=True, Remove=True, LDist=0.005)  # -> Point, Beam, Info
supp = Support(PosInd=flatten([end.Start, end.End]), menu=[buttons(on, on, on, on, off, off)])
# define supports
supp_2 = Support(PosInd=flatten(vec_3.Vector), menu=[buttons(on, on, on, on, off, off)])
pload = PointLoad(Vector="0,0,-50", PosInd=item, LCase=0)
# add gravity
gravity = Gravity(Vector="0,0,-1", LCase=0)
panel_4 = Panel("""1
0
1
1""")
panel_5 = Panel("""30
8
200
80""")
panel_6 = Panel("""5
2
10
5""")
# modify beam
modify_beam = ModifyBeam(
    Beam=linetobeam.Beam,
    Bending=graft(panel_4),
    Active=True,
    Height_cm=graft(panel_5),
    Thickness_cm=graft(panel_6),
    ConsiderBuckling=True,
    BucklingLengthY_m=-1,
    BucklingLengthZ_m=-1)
panel_7 = Panel("C:\My Work\Geometry Gym\documents\GeometryGym\analysis\karamba\suspension.ifc")
# assemble
assemble = AssembleModelKaramba(Point=pt, Beam=flatten(modify_beam), Support=[supp_2, supp], Load=[pload, gravity], LDist=0.005)  # -> Model, Info, Mass
# analyze
analyze = Analyze(Model=assemble.Model)  # -> ModelWithDisplacements, MaximumDisplacement, DeadWeight, ElasticEnergy
ggkarambaexport = GgKarambaExport(Enabled=True, Model=assemble.Model, FilePath=panel_7)
panel_8 = Panel(ggkarambaexport)
# view result
modelview = ModelViewKaramba(Model=analyze.ModelWithDisplacements, LoadCaseFactorsForLinearSuperposition=1, IndexIncrementOfVisibleLoadcase=0)  # -> Model, MeshOfRendering, DeformedStructure, DeformedModel
beamview = BeamViewKaramba(Model=modelview.Model)  # -> Model, MeshOfRendering, DeformedBeamAxes, LegendColors, LegendTags
