# Grasshopper definition Geometry Gym Grasshopper to GSA.ghx (Grasshopper 0.9.76)

# Requires ggRhinoGSA and BullAnt from http://www.geometrygym.com/downloads
# Assumes rhino documents have millimetre units
# Notes
# + You can use any units you like, but you need to scale the dimensions appropriately.
# + Recommended to change Grasshopper Display setting to "Draw Full Names" on Display Menu
# + All components output text in GWA data  format
# New Features to Implement (coming soon)
panel = Panel("GhGsaTitle")
vector_xyz = VectorXYZ(XComponent="2.05E9", YComponent="2.05E9", ZComponent="2.05E9")  # -> Vector, Length
# Create GSA Load Case
panel_2 = Panel("MyLoadCase")
gggsalocation = GgGSALocation(North=90, Elevation=0, Latitude=0, Longitude=0)
# Create GSA Project Data
gggsaproject = GgGSAProject(Title=panel, Subtitle="GhGsaSubTitle", CalcHeader="GhGsaCalcHeader", JobNumber="1", Initials="gh")
# Elastic Orhotropic
gggsacreate_elastic_orthotropic_material = GgGSACreateElasticOrthotropicMaterial(
    Name="MyOrthoSteel",
    StandardStructureMaterial="UNDEF",
    ElasticModulusPa=vector_xyz.Vector,
    PoissonsRatio=Vector(0.3, 0.3, 0.3),
    Density=7850,
    CoefficientOfThermalExpansion=Vector(1.2e-05, 1.2e-05, 1.2e-05),
    ShearModulusPa=Vector(0, 0, 0),
    DampingRatio=0,
    Color=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)
# Create GSA Material
# GSA Library
gggsacreate_material = GgGSACreateMaterial(StandardStructureMaterial="CONC_SHORT")
# Elastic Isotropic
gggsacreate_elastic_isotropic_material = GgGSACreateElasticIsotropicMaterial(
    Name="MySteel",
    ElasticModulusPa=2.05e+11,
    PoissonsRatio=0.3,
    ShearModulusPa=0,
    Density=7850,
    CoefficientOfThermalExpansion=1.2e-05,
    DampingRatio=0)
# Fabric
gggsacreate_fabric_material = GgGSACreateFabricMaterial(
    Name="MyFabric",
    ID=1,
    FabricWarpModulusNM=800000,
    FabricWeftModulusNM=400000,
    PoissonsRatio=0.45,
    ShearModulusNM=30000,
    Compression=False)
gggsaloadcase = GgGSALoadCase(Name=panel_2, ID=1, LoadCaseType="UNDEF", Bridge=False)
panel_3 = Panel(gggsaproject)
# Right Click input for combo box selection
panel_4 = Panel(gggsacreate_material)
panel_5 = Panel(gggsacreate_fabric_material)
panel_6 = Panel(gggsacreate_elastic_isotropic_material)
# Create GSA Region
panel_7 = Panel(gggsacreate_elastic_orthotropic_material)
panel_8 = Panel(gggsaloadcase)
# Export Model From Grasshopper
# Double Click on ggGSABakeModel to export
# out to the GSA Application.   You should have
# GSA running with the opening dialog cleared
# prior to baking, else GSA will be started as a
# background service you can't access.
# (this is useful if you are executing the solver
# and don't need manual interaction)
# Restart Rhino and GSA if problems.
# Don't manually close GSA documents
# Right click options :
# add GWA data to clipboard when baking
# new model initiated each bake
# Supress license to enable Architects to visualize model with BullAnt license
# Create GSA Beam
# Create GSA FiniteElements
gggsabakemodel = GgGSABakeModel(BakeAll=False, ClipSummary=False, NewFile=False, SecProps=True)
# Stream Bake to File
panel_9 = Panel("C:\MyWork\GSA\bake.gwb")
# Solve GSA Model
# Extract Results
gggsastream_bake = GgGSAStreamBake(Path=panel_9, Enabled=Toggle(False))
