# Grasshopper definition Geometry Gym Grasshopper to Revit.ghx (Grasshopper 0.9.76)

# Requires ggRhinoIFC from http://www.geometrygym.com/downloads
# Assumes rhino documents have millimetre units
# Notes
# + You can use any units you like, but you need to scale the dimensions appropriately.
# + Recommended to change Grasshopper Display setting to "Draw Full Names" on Display Menu
# New Features to Implement (coming soon)
# + Ability to Export from Revit a Template with materials and families to use in Grasshopper
# Export Model From Grasshopper
# Double Click on ggRvt BakeToFile
# to export out to the IFC file.
# You should then use the Geometry
# Gym Revit plugin to import the IFC
# file into an open Revit Project
ggrvt_baketofile = GgRvtBaketoFile(Accurate=True, IFC4=True, Radians=True, RepMapExport="OFF")
# Attributes input is reserved for future
# improvements such as setting physical
# attributes of the material.
panel = Panel("S355JR")
# Create Revit Material
# Right click on inputs such as Class
# for selection inputs
panel_2 = Panel("Concrete")
ggrvt_material = GgRvtMaterial(Name=panel, Description="Steel", Class=8)
ggrvt_material_2 = GgRvtMaterial(Name=panel_2, Class=8)
# Right click on Profile to set from ComboBox
ggrvt_catalogueprofiledef = GgRvtCatalogueProfileDef(Region="EuroProfile", Serial="IPE600", Type="EP IPE Beams")
panel_3 = Panel("""Basement
Ground Floor
Level 1""")
# If names for families and materials are
# set to be consistent with those loaded in
# the revit project at time of import, the
# existing attributes will be used.  The
# import plugin will create them if not, and
# they can be manually changed at a later date.
series = Series(Start=-2700, Step=3250, Count=3)
# Create Revit Column
ggrvt_column_family = GgRvtColumnFamily(
    RvtProfile=ggrvt_catalogueprofiledef,
    RvtMaterial=ggrvt_material,
    Structural=True,
    ggIFC_ssiIds="6e765eec-a2f0-4bb4-89fd-2cba1e23ef78;30Jt2wZGP9u84xr9NrJsle")
# Create Revit Structrural Framing
ggrvt_framing_family = GgRvtFramingFamily(
    RvtProfile=ggrvt_catalogueprofiledef,
    RvtMaterial=ggrvt_material,
    ggIFC_ssiIds="034462a9-53ac-43e3-8636-fe2e6ab99a8c;23UCr1S8z1c9WCbLDgyOVl")
# Generate a Material Layer
panel_4 = Panel("200")
line = Line(Line((488, -4377, 0), (-6028, 3507, 0)))
# Create Revit Levels
ggrvt_level = GgRvtLevel(Name=panel_3, Elevation=series, ComputationHeight=0, Structural=True, BuildingStory=True)
ggrvt_materiallayer = GgRvtMaterialLayer(RvtMaterial=ggrvt_material_2, Thickness=panel_4, Function=0, Wraps=True, Structural=True, Variable=False)
# To Be Implemented
# Right click on inputs such as Usage
# for selection inputs
ggrvt_framing = GgRvtFraming(
    Usage=0,
    RvtFramingType=ggrvt_framing_family,
    Axis=line,
    Justification=7,
    ggIFC_ssiIds="b6e5ef3b-1f7f-4da8-bbbd-6a332f18a263;3rlQf1Q6jCaBolPnaLzDG5")
series_2 = Series(Start=-10000, Step=5000, Count=7)
series_3 = Series(Start=-10000, Step=5000, Count=7)
# Create Revit Grids
construct_point = ConstructPoint(XCoordinate=series_2, YCoordinate="-10000", ZCoordinate=0)
construct_point_2 = ConstructPoint(XCoordinate="-10000", YCoordinate=series_3, ZCoordinate=0)
# Create Revit Floor
panel_5 = Panel("MyFloorType")
# Create Revit Wall
# To Be Implemented
ggrvt_wall_family = GgRvtWallFamily(Name="MyWallType", LayersCore=ggrvt_materiallayer, Interior=True)
line_sdl = LineSDL(Start=construct_point, Direction=Vector(0, 1, 0), Length="30000")
line_sdl_2 = LineSDL(Start=construct_point_2, Direction=Vector(1, 0, 0), Length="30000")
point = Point([Point(-1378, 661, 0), Point(2295, 7714.552877, 0), Point(15628.97001, -1196, 0), Point(2483, -3575, 0), Point(3183.303921, -871, 0)])
ggrvt_floor_type = GgRvtFloorFamily(Name=panel_5, LayersCore=ggrvt_materiallayer, Interior=True)
list_length = ListLength(List=line_sdl_2)
interpolate = Interpolate(Vertices=point, Degree=3, Periodic=True, KnotStyle=1)  # -> Curve, Length, Domain
list_length_2 = ListLength(List=line_sdl)
series_4 = Series(Start=1, Step=1, Count=list_length)
sequence = Sequence(Count=list_length_2, CharPool="ABCDEFGHIJKLMNOPQRSTUVWXYZ", Format="{0}")
integer = Integer(series_4)
ggrvt_floor = GgRvtFloor(
    RvtFloorFamily=ggrvt_floor_type,
    PlanarSlabPerimeterCurveOrFace=interpolate.Curve,
    ggIFC_ssiIds="526f3a09-36af-48ac-99e0-116d33d78baf;0hP6MfPTnETRL$_Hq$7VUV")
ggifc_grid = GgIFCGrid(GridName=integer, Curve=line_sdl_2)
ggifc_grid_2 = GgIFCGrid(GridName=sequence, Curve=line_sdl)
