# Grasshopper definition Geometry Gym Grasshopper to Tekla.ghx (Grasshopper 0.9.76)

# Requires ggRhinoTekla from http://www.geometrygym.com/downloads
# Assumes rhino documents have millimetre units
# Notes
# + You can use any units you like, but you need to scale the dimensions appropriately.
# + Recommended to change Grasshopper Display setting to "Draw Full Names" on Display Menu
# New Features to Implement (coming soon)
panel = Panel("IPE200")
# Create Tekla Beam Property
# Name according to Tekla library or convention, contact Jon if not recognized
# Right click on Insert Point to set
# cardinal insertion point and
# Beam Type and Cast Unit to set
# attributes
ggteklacreatepropertybeam = GgTeklaCreatePropertyBeam(Name=panel, Material="S355JR", Class="4", InsertPoint="TOPMID", BeamType="BEAM", CastUnitType="PRECAST")
number_slider = Slider(20, range=0..100)
curve = Curve(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)
curve_2 = Curve(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)
divide_curve = DivideCurve(Curve=curve, Count=number_slider, Kinks=False)  # -> Points, Tangents, Parameters
divide_curve_2 = DivideCurve(Curve=curve_2, Count=number_slider, Kinks=False)  # -> Points, Tangents, Parameters
# Create Tekla Plate
line = Line(StartPoint=divide_curve.Points, EndPoint=divide_curve_2.Points)
# Export Model From Grasshopper
# Double Click on ggTeklaBakeModel to export
# out to the Tekla Application.   You should have
# Tekla running with a model open
# prior to baking
# Also ensure Tekla version open is consistent with
# installed ggRhinoTekla (ie v20.1)
# Right click options :
# max arc radius (else polyline)
# Tangency for plate fillet corners
ggteklabakemodel = GgTeklaBakeModel(MAXRADIUS=30, PLATEIGNORETANGENT=False)
# Export Tekla Database to IFC
# Useful if you don't have Tekla
# license/installed and want to send model to user that does.
ggteklabakeifc = GgTeklaBakeIFC(Accurate=True, IFC4=False, Radians=True)
# Create Tekla Beam
ggtekla_create_beam = GgTeklaCreateBeam(
    Prop=ggteklacreatepropertybeam,
    PathCurve=line,
    ggTekla_ssiIds="bbdd2b78-14ae-49a9-9214-c2b47844fcfd;e1ad735c-4d14-4a57-9d55-6ffa3d7f98f9;516acb84-30e6-4df1-bfad-d91de058e907;3ed059c5-00bc-4340-9ac3-71b502772afc;2a6b1869-1f43-4914-a14b-2cec9fb9b348;b01008f2-189c-4d09-9d99-4c11c043f39d;12b25188-b998-483e-bd95-5bcf3bbdbec7;474a0a0a-6e78-409e-922c-1eb2c2a35d87;b97263f5-1cf3-4d29-ad6c-08a573dc7aaf;7ef20823-4d99-4607-acb9-904d0d36ab28;82dc4736-b761-4108-98cf-a0232722511e;b0845ca7-d460-43a8-a083-eac77694ff4f;78699b0a-8639-41c9-a7a0-102acbbc2f3f;f959748b-76db-436a-ae60-0977a3d36e9d;b0d874f8-df9b-44f3-af9b-bbdeabf247b9;ba8a2fa2-7af6-4ee9-b0e1-890e68f459a9;71e0f1ca-45b4-4073-ab82-683bbceeb02c;afcb3fe3-4257-4fe1-b04f-5f4b9d30b2fb;82a5d87b-ba41-4d0d-bf9b-3f2f518d3ae8;5f4493e3-0ab0-41db-8ed6-c7763120014e;bccd6960-f450-4ea1-a772-dcca1dd0282f;12bddc09-214e-4bec-866b-2ab697f0d9f0")
